# Grasshopper definition 定容城市.gh (Grasshopper 1.0.7)
# Copyright: 版权归NCFZ数字设计平台所有，引用或修改请与本站联系。
# Copyright: Skywoolf

crv = Curve(<curve referenced from the Rhino model>)

测试用地2 = Circle({Plane=Plane(origin=(557.4240987, 477.5691285, 0), x=(-0.5169832135, -0.8559955356, 0), y=(0.8559955356, -0.5169832135, 0)), Radius=179.6770568})
测试用地3 = Curve(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)
# 单位：m
# 12.04
# 道路生成最后一步使用了trim region
测试用地1 = Rectangle({Plane=PlaneXY(374.0167782, 109.3530382, 0), Size=Domain2(u=-165.1169351..165.1169351, v=-147.9604545..147.9604545)})

原始用地红线 = Curve(graft(测试用地3))
panel = Panel("5")

# ---- group: 数据录入
# Step.1
# 
# 对录入的用地线进行整理。
# 01、断线闭合
# 02、方向修正
# 03、标高统一
# 04、矢量重建
# END.
录入 = 红线录入(原始红线=原始用地红线, 退线距离=panel)  # -> 用地红线, 建筑退线

# ---- group: 路网生成
# Step.2
# 
# 生成道路网格中心线。
# 01、按用地分组输出
# 02、控制划分面积
# 03、形式自由发挥
# 04、考虑是否增加环路
# END.
toggle = BooleanToggle(False)
panel_2 = Panel("15000")
大骏_v2_0 = 路网生成(crv=录入.用地红线, 最大面积=panel_2, 是否环路=toggle)

# ---- group: 区域划分
# Step.3
# 
# 生成可用地的区域。
# 01、确认建筑用地范围
# 02、输出道路边线
# END.
panel_3 = Panel("7")
地块划分 = 地块划分(建筑退线=录入.建筑退线, 道路中线=大骏_v2_0, 道路宽度=panel_3, 随机因子=Slider(100, range=0..100))  # -> 道路外沿, 建筑用地, 分割用地, 道路边线

# ---- group: 建筑生成
# Step.4
# 
# 生成反应建筑体量的层线。
# 01、分组输出建筑层线
# 02、控制容积率
# 03、形式自由发挥
# END.
容积率 = Panel("2.4")
大鲲v2_0 = 自动建筑(用地红线=录入.用地红线, 欲容积率=容积率, 建筑用地=地块划分.分割用地)  # -> simplify(建筑层线), 附属空地

# ----
geo = Geometry(Tree({0}: [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], {0;0}: [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]))

# ---- group: 绿化生成
# Step.5
# 
# 生成城市绿化。
# 01、生成行道树
# 02、圈地生成区域绿化
# END.
区域种树 = 区域种树(种树沿线=[地块划分.道路边线, 地块划分.道路外沿], 绿化区域=大鲲v2_0.附属空地)  # -> 生成树的线框_2, 生成树的体量_2

# ---- group: 停车布局
# Step.6
# 
# 生成城市停车。
# 01、沿外环路停车
# 02、沿内部路网停车
# END.
cluster = Cluster_6(布置用线=地块划分.建筑用地, 避让用线=大鲲v2_0.建筑层线, 道路外沿=地块划分.道路外沿)  # -> 车位排布, 车位画线, 车位数量, 垂直数量

# ----
S = Size(6)

# ---- group: 建筑编号
楼号显示 = 楼号显示(L=大鲲v2_0.建筑层线)
lng = ListLength(List=楼号显示)
series = Series(Start=0, Step=1, Count=lng)
tag = TextTag3D(Location=楼号显示, Text=series, Size=S, Colour=RGB(0, 0, 0), Justification=5)

# ----
boundary = BoundarySurfaces(Edges=大鲲v2_0.建筑层线)
preview = CustomPreview(建筑面层含屋顶=boundary, Material=ColourSwatch(SwatchColor=RGBA(255, 255, 255, 19)))
preview_2 = CustomPreview(Geometry=区域种树.生成树的体量_2, Material=ColourSwatch(SwatchColor=RGBA(84, 160, 168, 106)))
preview_3 = CustomPreview(Geometry=[cluster.车位排布, cluster.车位画线], Material=ColourSwatch(SwatchColor=RGBA(99, 148, 80, 106)))
item = ListItem(List=大鲲v2_0.建筑层线, Index=0, Wrap=True)
crv_2 = Curve([录入.用地红线, 录入.建筑退线, 地块划分.道路外沿, 地块划分.建筑用地, 地块划分.道路边线, cluster.车位排布, item, 地块划分.分割用地, cluster.车位画线])
preview_4 = CustomPreview(Geometry=crv_2, Material=ColourSwatch(SwatchColor=RGBA(202, 227, 226, 211)))
tstat = TreeStatistics(Tree=大鲲v2_0.建筑层线)  # -> Paths, Length, Count
runion = RegionUnion(Curves=cluster.车位排布)
entwine = Entwine(
    Branch00=录入.用地红线,
    Branch01=录入.建筑退线,
    Branch02=地块划分.道路边线,
    Branch03=地块划分.建筑用地,
    Branch04=item,
    Branch05=cluster.车位排布,
    Branch06=区域种树.生成树的体量_2,
    Branch07=cluster.车位数量,
    Branch08=大鲲v2_0.附属空地,
    Branch09=大骏_v2_0,
    Branch010=runion,
    Branch011=tstat.Length,
    FlattenInputs=True)

# ==== cluster 红线录入: 1-普遍CAD导入线存在诸多bug，该电池可有效改善大部分错误； 2-内部计算用地面积； //退线逻辑待升级
# 作者：Skywoolf
# NCF参数化建筑联盟：bbs.ncf-china.com
# NCFZ数字设计平台：ncf.cz-studio.com
# 相关书籍：《Grasshopper参数化设计教程》--“数字冥想”
# 共同维护知识产权平台，请勿删除。感谢您对国人设计技术原创的支持！
原始红线 = ClusterInput()  # 输入CAD导入的红线，注意单位推荐是米，（毫米单位图纸会造成局部运算量巨大）
# 开发日志：
# 190621：测试版封装
# //整理CAD线导入的bug，获得用地初始数据
# 
# //全局变量：
# 1、总用地面积；
# 
# //下一步优化：
# 1、不等距退线待优化；
# 2、统一单位待优化；
# 
# //评估测试：
# 1、独立闭合线框录入：正常
# 2、一组线段围合线框录入：正常
# 3、空间线框录入：平整至z值为0平面
# 4、局部不闭合线段录入：正常
# 5、多用地分组录入：正常
退线距离 = ClusterInput()  # 这部分目前是统一退线距离，不等距退线待优化
# 祁鹏远 -- NCF站长；C+Z合伙人建筑师
rp = RebuildPlus(C=原始红线, D="10")
offset = OffsetCurve(Curve=rp, Distance=expr("-x", 退线距离), Plane=PlaneXY(0, 0, 0), Corners=1)
sp = SimplifyPlus(T=offset)
建筑退线 = ClusterOutput(sp)
用地红线 = ClusterOutput(rp)  # 重建后的用地红线

# ==== cluster 区域种树
种树沿线 = ClusterInput()  # 排列行道树所需的道路边线
绿化区域 = ClusterInput()
绿化密度 = ClusterInput()  # 0 to 1之间
crv = Curve(种树沿线)
num = Number(绿化密度)
绿化区域_2 = Curve(graft(绿化区域))
cluster = Cluster_2(C=绿化区域_2, B=num)
cluster_2 = Cluster(C=crv)
merge = Merge(Data1=simplify(cluster_2), Data2=simplify(cluster))
len = Length(Curve=merge)
multiplication = Multiplication(A=len, B="0.1")
Z = UnitZ(Factor=multiplication)
multiplication_2 = Multiplication(A=Z, B=2)
move = Move(Geometry=merge, Motion=Z)  # -> Geometry, Transform
boundary = BoundarySurfaces(Edges=move.Geometry)
extr = Extrude(Base=boundary, Direction=multiplication_2)
生成树的线框 = Curve(merge)
生成树的体量 = Brep(extr)
生成树的线框_2 = ClusterOutput(生成树的线框)
生成树的体量_2 = ClusterOutput(生成树的体量)

# ==== cluster 地块划分: 1-基于路网进行地块划分； 2-生成基地内主干道及附属元素； 3-主干道宽度直径可调节； 4-可选择是否生成基地内环路； //V2.0 Supers 190624
# 作者：Supers
# NCF参数化建筑联盟：bbs.ncf-china.com
# NCFZ数字设计平台：ncf.cz-studio.com
# 相关书籍：《Grasshopper参数化设计教程》--“数字冥想”
# 共同维护知识产权平台，请勿删除。感谢您对国人设计技术原创的支持！
建筑退线 = ClusterInput()
道路中线 = ClusterInput()  # 输入道路的中心线
# 开发日志：
# 190621：测试版封装
# //V2.0 版本进行了彻底重写o(╥﹏╥)o，增加了是否环形道路的选择项，
# //V2.1 版本对无环道的建筑用地输出端重新整理，输出各个闭合地块儿。
# 
# 测试结果：
# //多个地块数据运算结果：正常 （需要用地和道路中线均进行相对应的分组）
# //单个地块运算结果：正常
道路宽度 = ClusterInput()  # 输入主路宽度
crv = Curve(建筑退线)
crv_2 = Curve(道路中线)
num = Number(道路宽度)
division = Division(A=num, B=2)
判断闭合 = 判断闭合(crv=crv_2, relay=division)  # -> crv_4, bool_2
len = Length(Curve=判断闭合.crv_4)
bnd = Bounds(Numbers=len)
dedomain = DeconstructDomain(Domain=bnd)  # -> Start, End
equals = Equality(FirstNumber=len, SecondNumber=dedomain.End)  # -> Equality, Inequality
dispatch = Dispatch(List=判断闭合.crv_4, DispatchPattern=equals.Equality)  # -> ListA, ListB
rdiff = RegionDifference(CurvesA=crv, CurvesB=dispatch.ListA)
addition = Addition(A="6", B=道路宽度)
sp = SimplifyPlus(T=rdiff)
sp_2 = SimplifyPlus(T=dispatch.ListB)
fillet = Fillet(Curve=dispatch.ListA, Radius=addition)
merge = Merge(Data1=sp, Data2=sp_2)
fillet_2 = Fillet(Curve=merge, Radius="6")
人行道宽度_m = Panel("-1.5")
offset = OffsetCurve(Curve=fillet_2, Distance=人行道宽度_m, Plane=fillet_2, Corners=1)  # -> reparameterize(Curve)
crv_3 = Curve(simplify(graft(offset)))
bbp = BoundboxPlus(C=crv_3, B=0)
随机因子 = ClusterInput()
filter = StreamFilter(Gate=判断闭合.bool_2, Stream1=fillet)
tstat = TreeStatistics(Tree=bbp)  # -> Paths, Length, Count
int = Integer(随机因子)
series = Series(Start=0, Step=1, Count=tstat.Count)  # -> graft(Series)
dd = DefaultData(I=int, D=1)
addition_2 = Addition(A=dd, B=series)
substrate = Substrate(Border=bbp, Count=3, Angles=0, Deviation=0, Seed=addition_2)  # -> simplify(Substrate)
cc = 切割线框(R=crv_3, C=substrate)
sp_3 = SimplifyPlus(T=offset)
sp_4 = SimplifyPlus(T=filter)
sp_5 = SimplifyPlus(T=cc)
sp_6 = SimplifyPlus(T=fillet_2)
crv_4 = Curve(sp_4)
crv_5 = Curve(sp_3)
crv_6 = Curve(sp_6)
crv_7 = Curve(sp_5)
道路外沿 = ClusterOutput(crv_4)  # 有环路时，才有输出结果
建筑用地 = ClusterOutput(crv_5)  # 人行道路边线，建筑用地范围
分割用地 = ClusterOutput(crv_7)  # 人行道路边线，建筑用地范围
道路边线 = ClusterOutput(crv_6)  # 车行道路的边线

# ==== cluster 路网生成: 1-已知用地范围智能生成路网； 2-当划分用地大于最大面积时自动进行进一步划分； 3-路网随随机因子的改变而随机改变； 4-兼容多地块同时生成； //当用地过大时，会出现无法再进一步划分的bug
随机因子 = ClusterInput()  # 每个整数对应一种随机结果
dd = DefaultData(I=随机因子, D="32")
int = Integer(dd)
最大面积 = ClusterInput()  # 当分割后的用地超过最大面积会自动进入下一步切分
series = Series(Start=int, Step=3, Count=7)  # -> graft(Series)
# 作者：Skywoolf
# NCF参数化建筑联盟：bbs.ncf-china.com
# NCFZ数字设计平台：ncf.cz-studio.com
# 相关书籍：《Grasshopper参数化设计教程》--“数字冥想”
# 共同维护知识产权平台，请勿删除。感谢您对国人设计技术原创的支持！
crv = ClusterInput()
num = Number(最大面积)
bang = ExplodeTree(Data=series)  # -> Branch0, Branch1, Branch2, Branch3, Branch4, Branch5, Branch6
# 祁鹏远 -- NCF站长；C+Z合伙人建筑师
crv_2 = Curve(graft(crv))
lng = ListLength(List=flatten(crv_2))
equals = Equality(FirstNumber=lng, SecondNumber="1")  # -> Equality, Inequality

area = Area(Geometry=crv_2)  # -> Area, Centroid
larger = LargerThan(FirstNumber=area.Area, SecondNumber=num)  # -> LargerThan, OrEqualTo
dispatch = Dispatch(List=crv_2, DispatchPattern=larger.LargerThan)  # -> ListA, ListB

clean = CleanTree(RemoveNulls=True, RemoveInvalid=True, RemoveEmpty=True, Tree=dispatch.ListA)

cluster = Cluster_4(R=clean, S=bang.Branch0)  # -> R_2, C
area_2 = Area(Geometry=cluster.R_2)  # -> Area, Centroid
larger_2 = LargerThan(FirstNumber=area_2.Area, SecondNumber=num)  # -> LargerThan, OrEqualTo
dispatch_2 = Dispatch(List=cluster.R_2, DispatchPattern=larger_2.LargerThan)  # -> ListA, ListB

clean_2 = CleanTree(RemoveNulls=True, RemoveInvalid=True, RemoveEmpty=True, Tree=dispatch_2.ListA)

cluster_2 = Cluster_4(R=clean_2, S=bang.Branch1)  # -> R_2, C
area_3 = Area(Geometry=cluster_2.R_2)  # -> Area, Centroid
larger_3 = LargerThan(FirstNumber=area_3.Area, SecondNumber=num)  # -> LargerThan, OrEqualTo
dispatch_3 = Dispatch(List=cluster_2.R_2, DispatchPattern=larger_3.LargerThan)  # -> ListA, ListB

clean_3 = CleanTree(RemoveNulls=True, RemoveInvalid=True, RemoveEmpty=True, Tree=dispatch_3.ListA)

cluster_3 = Cluster_4(R=clean_3, S=bang.Branch2)  # -> R_2, C
area_4 = Area(Geometry=cluster_3.R_2)  # -> Area, Centroid
larger_4 = LargerThan(FirstNumber=area_4.Area, SecondNumber=num)  # -> LargerThan, OrEqualTo
dispatch_4 = Dispatch(List=cluster_3.R_2, DispatchPattern=larger_4.LargerThan)  # -> ListA, ListB

clean_4 = CleanTree(RemoveNulls=True, RemoveInvalid=True, RemoveEmpty=True, Tree=dispatch_4.ListA)

cluster_4 = Cluster_4(R=clean_4, S=bang.Branch3)  # -> R_2, C
area_5 = Area(Geometry=cluster_4.R_2)  # -> Area, Centroid
larger_5 = LargerThan(FirstNumber=area_5.Area, SecondNumber=num)  # -> LargerThan, OrEqualTo
dispatch_5 = Dispatch(List=cluster_4.R_2, DispatchPattern=larger_5.LargerThan)  # -> ListA, ListB

clean_5 = CleanTree(RemoveNulls=True, RemoveInvalid=True, RemoveEmpty=True, Tree=dispatch_5.ListA)

cluster_5 = Cluster_4(R=clean_5, S=bang.Branch4)  # -> R_2, C
area_6 = Area(Geometry=cluster_5.R_2)  # -> Area, Centroid
larger_6 = LargerThan(FirstNumber=area_6.Area, SecondNumber=num)  # -> LargerThan, OrEqualTo
dispatch_6 = Dispatch(List=cluster_5.R_2, DispatchPattern=larger_6.LargerThan)  # -> ListA, ListB

clean_6 = CleanTree(RemoveNulls=True, RemoveInvalid=True, RemoveEmpty=True, Tree=dispatch_6.ListA)

cluster_6 = Cluster_4(R=clean_6, S=bang.Branch5)  # -> R_2, C
area_7 = Area(Geometry=cluster_6.R_2)  # -> Area, Centroid
larger_7 = LargerThan(FirstNumber=area_7.Area, SecondNumber=num)  # -> LargerThan, OrEqualTo
dispatch_7 = Dispatch(List=cluster_6.R_2, DispatchPattern=larger_7.LargerThan)  # -> ListA, ListB

clean_7 = CleanTree(RemoveNulls=True, RemoveInvalid=True, RemoveEmpty=True, Tree=dispatch_7.ListA)

# ----
# 开发日志：
# 190621：测试版封装
# //模拟循环算法，将地块气氛成指定大小以下；
# 190715：优化初始变量过小的bug
# 190715：重修树形数据bug
# 190715：发现Cluster接口Null导致输出口内外不一致的gh原生bug
# 
# 
# //下一步优化：
# 1、循环算法优化；
# 
# //评估测试：
# 1、独立闭合线框录入：正常
# 2、多个闭合线框录入：正常
cluster_7 = Cluster_4(R=clean_7, S=bang.Branch6)  # -> R_2, C
area_8 = Area(Geometry=cluster_7.R_2)  # -> Area, Centroid
larger_8 = LargerThan(FirstNumber=area_8.Area, SecondNumber=num)  # -> LargerThan, OrEqualTo
dispatch_8 = Dispatch(List=cluster_7.R_2, DispatchPattern=larger_8.LargerThan)  # -> ListA, ListB

crv_3 = Curve(cluster_7.C)
clean_8 = CleanTree(RemoveNulls=True, RemoveInvalid=True, RemoveEmpty=True, Tree=dispatch_8.ListA)
merge = Merge(
    Data1=cluster.C,
    Data2=cluster_2.C,
    Data3=cluster_3.C,
    Data4=cluster_4.C,
    Data5=cluster_5.C,
    Data6=cluster_6.C,
    Data7=cluster_7.C)
data = Data(flatten(merge))
filter = StreamFilter(Gate=equals.Equality, Stream0=merge, Stream1=data)
clean_9 = CleanTree(RemoveNulls=True, RemoveInvalid=True, RemoveEmpty=True, Tree=filter)  # -> simplify(Tree)
addition = Addition(A="3", B="3.5")
crv_4 = Curve(crv_2)
crv_5 = Curve(clean_9)
offset = OffsetCurve(Curve=crv_4, Distance=expr("-x", addition), Plane=PlaneXY(0, 0, 0), Corners=1)
trim = TrimWithRegion(Curve=crv_5, Region=offset)  # -> Inside, Outside
crv_6 = Curve(simplify(trim.Inside))
ttp = TrimTreePlus(T=crv_6, D=1)
是否环路 = ClusterInput()
sp = SimplifyPlus(T=ttp)
sp_2 = SimplifyPlus(T=offset)
bool = Boolean(是否环路)
merge_2 = Merge(Data1=sp, Data2=sp_2)
filter_2 = StreamFilter(Gate=bool, Stream0=crv_5, Stream1=merge_2)
crv_7 = Curve(filter_2)
道路中线 = ClusterOutput(crv_7)

# ==== cluster 自动建筑: 1-根据用地自动划分并分析地块； 2-自动生成多样式的建筑体量； //V1.1 skywoolf 190717
# 作者：Skywoolf
# NCF参数化建筑联盟：bbs.ncf-china.com
# NCFZ数字设计平台：ncf.cz-studio.com
# 相关书籍：《Grasshopper参数化设计教程》--“数字冥想”
# 祁鹏远 -- NCF站长；C+Z合伙人建筑师
# 共同维护知识产权平台，请勿删除。感谢您对国人设计技术原创的支持！
# 开发日志：
# 190717：测试版封装
# //这个算法仅是一个框架演示。未来建筑轮廓生成逻辑有待深化。
# 190725：修复偶尔出现空中飘板得bug
# 
# //下一步优化：
# 1、丰富建筑形态逻辑；
# 
# //评估测试：
# 1、独立闭合线框录入：正常
# 2、多个闭合线框录入：正常
建筑用地 = ClusterInput()

分类用地 = 分类用地(用地=建筑用地)  # -> 不良用地, 过长用地, 过大用地, 适中用地, 较小用地
切分排楼 = 切分排楼(用地=分类用地.过长用地)  # -> T, path_mapper_3, path_mapper_4
高层建筑 = 高层建筑(C=分类用地.适中用地)  # -> path_mapper_2, path_mapper_4
独立建筑 = 独立建筑(C=分类用地.较小用地)  # -> path_mapper_3, path_mapper_4
组合排楼 = 组合排楼(C=分类用地.过大用地)  # -> path_mapper_5, path_mapper_6, path_mapper_7, path_mapper_8

panel = Panel(切分排楼.T)
欲容积率 = ClusterInput()
用地红线 = ClusterInput()
merge = Merge(Data1=切分排楼.T, Data2=组合排楼.path_mapper_5, Data3=组合排楼.path_mapper_6, Data4=高层建筑.path_mapper_2, Data5=独立建筑.path_mapper_3)
容积率校对 = 容积率校对(用地红线=用地红线, B=欲容积率, crv=merge)  # -> R, R_2
merge_2 = Merge(Data1=切分排楼.path_mapper_4, Data2=组合排楼.path_mapper_8, Data3=分类用地.不良用地)
panel_2 = Panel(容积率校对.R)
crv = Curve(容积率校对.R_2)
crv_2 = Curve(merge_2)
建筑层线 = ClusterOutput(crv)
附属空地 = ClusterOutput(crv_2)

# ==== cluster 楼号显示
L = ClusterInput()
item = ListItem(List=L, Index=-1, Wrap=True)
area = Area(Geometry=item)  # -> Area, flatten(Centroid)
pt = Point(area.Centroid)
pt_2 = ClusterOutput(pt)

# ==== cluster Cluster_6
# 作者：Supers＆LYF
# NCF参数化建筑联盟：bbs.ncf-china.com
# NCFZ数字设计平台：ncf.cz-studio.com
# 相关书籍：《Grasshopper参数化设计教程》--“数字冥想”
# 共同维护知识产权平台，请勿删除。感谢您对国人设计技术原创的支持！
# 开发日志：
# 2019.05.10 V1.3 更新
# 修复bug
# 1.由车位的道路起点算起进行排列
# 2.弯道周围减去一个车位
# 3.车位两个定位点判断距建筑距离，解决横纵交叠问题
# 
# 
# 2019.05.15  V1.4 更新
# 修复bug
# 1.建筑产品较小，将判断距离的线切成两段
# 导致数据不匹配而导致的车位错位。修改后合并为一个数据
# 
# 2019.05.28  V1.5 更新
# 1.将外环车位融合到功能中
# 
# 输入端：   布置用线，需各线之间单独分组
#                 避让用线，输入后内置被flatten
#                 道路外沿，各地块单独分组
# 
# 2019.07.15  V2.0 更新
# 对算法进行重构，减少运算量。
# 拟加入圈地排位。
# 
# 
# 测试结果v1.5：
# //多个地块数据运算结果：正常
# //单个地块运算结果：正常
布置用线 = ClusterInput()
避让用线 = ClusterInput()
crv = Curve(布置用线)
crv_2 = Curve(避让用线)

# ---- group: 一级筛选竖排车位
uod = UnityOfDirection_2(crv=crv_2)
uod_2 = UnityOfDirection_2(crv=crv)
offset = OffsetCurve(Curve=uod_2, Distance=expr("-x", "5.5"), Plane=PlaneXY(0, 0, 0), Corners=1)
offset_2 = OffsetCurve(Curve=uod, Distance="2", Plane=PlaneXY(0, 0, 0), Corners=1)  # -> flatten(Curve)
extr = Extrude(Base=offset_2, Direction="0,0,-1")
split = SplitWithBreps(Curve=flatten(offset), Brep=extr)  # -> Curve, Points
explode = Explode(Curve=split.Curve, Recursive=True)  # -> Segments, Vertices
curvepoint = PointOnCurve(explode.Segments, parameter=0.514)
incurves = PointInCurves(Point=graft(curvepoint), Curves=offset_2)  # -> Relationship, Index, Point
trim = TrimTree(Tree=incurves.Relationship, Depth=1)
dispatch = Dispatch(List=explode.Segments, DispatchPattern=trim)  # -> ListA, ListB
非竖排 = Curve(dispatch.ListA)
竖排 = Curve(dispatch.ListB)

# ----
panel = Panel("有漏洞 太远不行 ")

# ---- group: 二级筛选横排车位
flip = FlipCurve(Curve=非竖排)  # -> Curve, Flag
offset_3 = OffsetCurve(Curve=flip.Curve, Distance=expr("-x", Slider(3, range=0..10)), Plane=PlaneXY(0, 0, 0), Corners=1)
divide = DivideCurve(Curve=offset_3, Count=Slider(2, range=0..10), Kinks=False)  # -> Points, Tangents, Parameters
shift = ShiftList(List=divide.Points, Shift=1, Wrap=Toggle(False))
shift_2 = ShiftList(List=shift, Shift=expr("-x", Slider(1, range=0..1)), Wrap=Toggle(False))
incurves_2 = PointInCurves(Point=shift_2, Curves=offset_2)  # -> Relationship, Index, Point
bool = Boolean(incurves_2.Relationship)
subtraction = Subtraction(A=bool, B=Slider(1, range=0..1))
pshift = ShiftPaths(Data=subtraction, Offset="-3")
cull = CullPattern(List=offset_3, CullPattern=pshift)
crv_3 = Curve(cull)

# ----
道路外沿 = ClusterInput()  # 各地块单独分组的环形道路外边缘
外环排车位 = 外环排车位(C=道路外沿)  # -> 外环车位_2, L
crv_4 = Curve(竖排)
flip_2 = FlipCurve(Curve=crv_4)  # -> Curve, Flag

# ---- group: 车位定位点和坐标系
divlength = DivideLength(Curve=flip_2.Curve, Length="2.5")  # -> Points, Tangents, Parameters
lng = ListLength(List=divlength.Parameters)
lng_2 = ListLength(List=divlength.Tangents)
cull_i = CullIndex(List=divlength.Parameters, Indices=expr("x-1", lng), Wrap=True)
cull_i_2 = CullIndex(List=divlength.Tangents, Indices=expr("x-1", lng_2), Wrap=True)
shatter = Shatter(Curve=graft(flip_2.Curve), Parameters=cull_i)  # -> simplify(Segments)
rotate = Rotate(Geometry=cull_i_2, Angle=1.570796327, Plane=PlaneXY(0, 0, 0))  # -> Geometry, Transform
end = EndPoints(Curve=shatter)  # -> Start, End
line = LineSDL(Start=end.Start, Direction=rotate.Geometry, Length=1)
end_2 = EndPoints(Curve=line)  # -> Start, End
pl_3pt = Plane3Pt(PointA=end.Start, PointB=end.End, PointC=end_2.End)

# ----
explode_2 = Explode(Curve=外环排车位.外环车位_2, Recursive=True)  # -> Segments, Vertices
item = ListItem(List=explode_2.Segments, Index=1, Wrap=True)
curvepoint_2 = PointOnCurve(item, parameter=0.5)
item_2 = ListItem(List=explode_2.Vertices, Index=0, Wrap=True)  # -> Item, Item1, Item2, Item3
merge = Merge(Data1=item_2.Item, Data2=curvepoint_2, Data3=item_2.Item3)
pline = PolyLine(Vertices=merge, Closed=False)

divlength_2 = DivideLength(Curve=crv_3, Length="5.5")  # -> Points, Tangents, Parameters
lng_3 = ListLength(List=divlength_2.Parameters)
lng_4 = ListLength(List=divlength_2.Tangents)
cull_i_3 = CullIndex(List=divlength_2.Parameters, Indices=expr("x-1", lng_3), Wrap=True)
cull_i_4 = CullIndex(List=divlength_2.Tangents, Indices=expr("x-1", lng_4), Wrap=True)
shatter_2 = Shatter(Curve=graft(crv_3), Parameters=cull_i_3)  # -> simplify(Segments)
rotate_2 = Rotate(Geometry=cull_i_4, Angle=1.570796327, Plane=PlaneXY(0, 0, 0))  # -> Geometry, Transform
end_3 = EndPoints(Curve=shatter_2)  # -> Start, End
line_2 = LineSDL(Start=end_3.Start, Direction=rotate_2.Geometry, Length=1)
end_4 = EndPoints(Curve=line_2)  # -> Start, End
pl_3pt_2 = Plane3Pt(PointA=end_3.Start, PointB=end_3.End, PointC=end_4.End)

dom = ConstructDomain(DomainStart=0, DomainEnd="5.5")
P = Plane(PlaneXY(0, 0, 0))
rectangle = Rectangle(Plane=P, XSize=dom, YSize=Domain(0, 2.5), Radius=0)  # -> Rectangle, Length
orient = Orient(Geometry=rectangle.Rectangle, Source=P, Target=pl_3pt_2)  # -> Geometry, Transform
crv_5 = Curve(orient.Geometry)

# ---- group: 布置车位
dom_2 = ConstructDomain(DomainStart=0, DomainEnd="5.5")
P_2 = Plane(PlaneXY(0, 0, 0))
rectangle_2 = Rectangle(Plane=P_2, XSize=Domain(0, 2.5), YSize=dom_2, Radius=0)  # -> Rectangle, Length
orient_2 = Orient(Geometry=rectangle_2.Rectangle, Source=P_2, Target=pl_3pt)  # -> Geometry, Transform
crv_6 = Curve(orient_2.Geometry)

# ----
merge_2 = Merge(Data1=外环排车位.外环车位_2, Data2=pline)
number_slider = Slider(10, range=0..10)

explode_3 = Explode(Curve=crv_5, Recursive=True)  # -> Segments, Vertices
item_3 = ListItem(List=explode_3.Segments, Index=1, Wrap=True)
curvepoint_3 = PointOnCurve(item_3, parameter=0.5)
item_4 = ListItem(List=explode_3.Vertices, Index=0, Wrap=True)  # -> Item, Item1, Item2, Item3
merge_3 = Merge(Data1=item_4.Item, Data2=curvepoint_3, Data3=item_4.Item3)
pline_2 = PolyLine(Vertices=merge_3, Closed=False)

explode_4 = Explode(Curve=crv_6, Recursive=True)  # -> Segments, Vertices
item_5 = ListItem(List=explode_4.Segments, Index=Slider(2, range=0..10), Wrap=True)
item_6 = ListItem(List=explode_4.Vertices, Index=0, Wrap=True)  # -> Item, Item1, Item2, Item3
curvepoint_4 = PointOnCurve(item_5, parameter=0.5)
merge_4 = Merge(Data1=item_6.Item, Data2=curvepoint_4, Data3=item_6.Item1)
pline_3 = PolyLine(Vertices=merge_4, Closed=False)

lng_5 = ListLength(List=flatten(crv_6))
lng_6 = ListLength(List=flatten(crv_5))
lng_7 = ListLength(List=flatten(外环排车位.外环车位_2))
merge_5 = Merge(Data1=lng_5, Data2=lng_6, Data3=lng_7)
ma = MassAddition(Input=merge_5)  # -> Result, PartialResults
ma_2 = MassAddition(Input=lng_5)  # -> Result, PartialResults
pshift_2 = ShiftPaths(Data=pline_2, Offset=-1)
pshift_3 = ShiftPaths(Data=pline_3, Offset=-1)
int = Integer(ma_2.Result)
int_2 = Integer(ma.Result)
车位数量 = ClusterOutput(int_2)  # 场地内所有路边地面车位总数
垂直数量 = ClusterOutput(int)
merge_6 = Merge(Data1=crv_5, Data2=pshift_2)
merge_7 = Merge(Data1=crv_6, Data2=pshift_3)
merge_8 = Merge(Data1=crv_5, Data2=crv_6, Data3=外环排车位.外环车位_2)
crv_7 = Curve(merge_8)
merge_9 = Merge(Data1=merge_6, Data2=merge_7, Data3=merge_2)
车位排布 = ClusterOutput(crv_7)
crv_8 = Curve(merge_9)
车位画线 = ClusterOutput(crv_8)

# ==== cluster RebuildPlus: 对导入的其他软件曲线进行平面化重建，尤其适用于CAD导入用地红线，可有效规避部分图纸矢量bug； Input: C-导入的曲线（如CAD曲线）； Output： C-重建后的平面闭合曲线； //目前自动优化以下效果： //1-自动转多段线； //2-自动统一为0标高； //3-部份不闭合曲线自动闭合； //提示：部分红线转多段线后，面积会有微小变化；
# 作者：Skywoolf
# NCF参数化建筑联盟：bbs.ncf-china.com
# NCFZ数字设计平台：ncf.cz-studio.com
# 相关书籍：《Grasshopper参数化设计教程》--“数字冥想”
# 共同维护知识产权平台，请勿删除。感谢您对国人设计技术原创的支持！
# 开发日志：
# 190620：测试版封装
# //如果CAD里线没问题，当然这步骤是可以省略的，大部分显示矢量跳动现象是由于图纸矢量距离原点过远导致；
# //对于其他不确定性bug，这个算法因为是在Rhino中重建了曲线，所以能有效的起到缓解作用，但也可能有其他无法解决的情况；
# 
# //单个数据成功运算结果：正常
# //树形数据测试结果：正常（每个封闭线框独立一组）
C = ClusterInput()  # 输入CAD用地红线，建议图纸单位：米
crv = Curve(C)
D = ClusterInput()  # 红线采样点大约间距
# 祁鹏远 -- NCF站长；C+Z合伙人建筑师
len = Length(Curve=crv)
integer_division = IntegerDivision(A=len, B=D)
divide = DivideCurve(Curve=crv, Count=integer_division, Kinks=True)  # -> Points, Tangents, Parameters
pdecon = Deconstruct(Point=divide.Points)  # -> XComponent, YComponent, ZComponent
pt = ConstructPoint(XCoordinate=pdecon.XComponent, YCoordinate=pdecon.YComponent, ZCoordinate="0")
cullpt = CullDuplicates(Points=pt, Tolerance=0.1, CullMode=3)  # -> Points, Indices, Valence
pline = PolyLine(Vertices=cullpt.Points, Closed=True)
simplify = SimplifyCurve(Curve=pline)  # -> Curve, Simplified
fp2d = FlipcurvePLus2D(C=simplify.Curve)
# 将线框优化成平面
# 根据近似距离函数等分取点
crv_2 = Curve(fp2d)
# 将线框优化成平面
# 将线框优化成闭合曲线
C_2 = ClusterOutput(crv_2)  # 优化平整后的闭合线框

# ==== cluster SimplifyPlus: Simplify的升级版，原生电池中Simplify遇到单组数据不会优化数据级，这使得它在于pathmapper搭配的时候经常会出现数据无法联动的困扰。Slimplify Plus在原有基础上增加了新的规则，当多级路径名的单组数据输入给它的时候，它会将数据拍平至最简； //V1.2 skywoolf 190617
# 作者：Skywoolf
# NCF参数化建筑联盟：bbs.ncf-china.com
# NCFZ数字设计平台：ncf.cz-studio.com
# 相关书籍：《Grasshopper参数化设计教程》--“数字冥想”
# 共同维护知识产权平台，请勿删除。感谢您对国人设计技术原创的支持！
# 开发日志：
# 190620：测试版封装
# //为了让Cluster打包后输入端能够兼容单个数据和树形数据，这里对Simplify做的改造，原版Simplify不能自动把单组数据简化；
# //这里增加了对单组数据直接拍平的设置，为了在复杂的运算器过程中，路径名变化能够实现联动控制，不会因为树形转线性后路径名不变而产生bug；
# 
# //单个数据成功运算结果：正常
# //树形数据测试结果：正常
T = ClusterInput()  # 需要简化路径名的数据
data = Data(T)
# 祁鹏远 -- NCF站长；C+Z合伙人建筑师
tstat = TreeStatistics(Tree=data)  # -> Paths, Length, Count
equals = Equality(FirstNumber=tstat.Count, SecondNumber=1)  # -> Equality, Inequality
dispatch = Dispatch(List=data, DispatchPattern=equals.Equality)  # -> ListA, ListB
simplify = SimplifyTree(Tree=dispatch.ListB, Front=False)
flatten = FlattenTree(Tree=dispatch.ListA, Path="{0}")
filter = StreamFilter(Gate=equals.Equality, Stream0=simplify, Stream1=flatten)
data_2 = Data(filter)
T_2 = ClusterOutput(data_2)  # 简化路径名后的数据

# ==== cluster Cluster
C = ClusterInput()

# ---- group: 选出道路外边线直线段
explode = Explode(Curve=C, Recursive=True)  # -> simplify(Segments), Vertices
line = Line(explode.Segments)
clean = CleanTree(RemoveNulls=True, RemoveInvalid=True, RemoveEmpty=False, Tree=line)  # -> flatten(Tree)

# ----
number_slider = Slider(5, range=0..6)
divlength = DivideLength(Curve=clean, Length=number_slider)  # -> Points, Tangents, Parameters
cull_i = CullIndex(List=divlength.Points, Indices=0, Wrap=True)
cir = Circle(Plane=cull_i, Radius=expr("x/2", number_slider))
cull = CullPattern(List=cir, CullPattern=[True, True, False, True, True, True, False, True, True, True, True, False])

L = ClusterOutput(cull)

# ==== cluster Cluster_2
C = ClusterInput()
bbox = BoundingBox(Content=C, Plane=PlaneXY(0, 0, 0))  # -> Box, Box_2
tstat = TreeStatistics(Tree=bbox.Box)  # -> Paths, Length, Count

# ---- group: 自动计算所需数量
area = Area(Geometry=bbox.Box)  # -> Area, Centroid
division = Division(A=area.Area, B="200")

# ----
series = Series(Start=0, Step=1, Count=tstat.Count)  # -> graft(Series)
pop2d = Populate2D(Region=bbox.Box, Count=division, Seed=series)
B = ClusterInput()
lng = ListLength(List=pop2d)
multiplication = Multiplication(A=lng, B=B)
subtraction = Subtraction(A=lng, B=multiplication)
reduce = RandomReduce(List=pop2d, Reduction=subtraction, Seed=1)
incurve = PointInCurve(Point=reduce, Curve=C)  # -> Relationship, Point
cull = CullPattern(List=reduce, CullPattern=incurve.Relationship)
range = Range(Domain="2 to 6", Steps=10)
lng_2 = ListLength(List=cull)
repeat = RepeatData(Data=range, Length=lng_2)
cir = Circle(Plane=cull, Radius=repeat)
C_2 = ClusterOutput(cir)

# ==== cluster BoundboxPlus: Boundbox的升级版，自动跟随异形的倾斜而生成非xy方向的倾斜box； Input： C-输入要套box的线框； G-开关：是否启动长边校正 Output： C-输出一个包含输入曲线的较小矩形； //目标是这个输出的矩形尽量小，这样可用于评判很多异形线框的形态； //V2.2 skywoolf 190617
# 作者：Skywoolf
# NCF参数化建筑联盟：bbs.ncf-china.com
# NCFZ数字设计平台：ncf.cz-studio.com
# 相关书籍：《Grasshopper参数化设计教程》--“数字冥想”
# 共同维护知识产权平台，请勿删除。感谢您对国人设计技术原创的支持！
C = ClusterInput()  # 需要计算矩形轮廓的曲线
# 祁鹏远 -- NCF站长；C+Z合伙人建筑师
crv = Curve(C)
explode = Explode(Curve=crv, Recursive=True)  # -> Segments, Vertices
# 开发日志：
# 190620：测试版封装
# //将曲线简化为矩形线框可以用来简化大部分的算法开发工作，此算法有待进化
# 
# //单个数据成功运算结果：正常
# //树形数据测试结果：正常
explode_2 = Explode(Curve=crv, Recursive=True)  # -> Segments, Vertices
hull = ConvexHull(Points=explode.Vertices, Plane=PlaneXY(0, 0, 0))  # -> Hull, HullZ, Indices
area = Area(Geometry=crv)  # -> Area, Centroid
ll = LongestLine(C=explode_2.Segments)  # -> cl, cs
crv_cp = CurveClosestPoint(Point=area.Centroid, Curve=hull.Hull)  # -> Point, Parameter, Distance
end = EndPoints(Curve=ll.cl)  # -> Start, End
xy = XYPlane(Origin=Point(0, 0, 0))
vec2pt = Vector2Pt(PointA=area.Centroid, PointB=crv_cp.Point, Unitize=False)  # -> Vector, Length
vec2pt_2 = Vector2Pt(PointA=end.Start, PointB=end.End, Unitize=False)  # -> simplify(Vector), Length
align = AlignPlane(Plane=xy, Direction=vec2pt_2.Vector)  # -> Plane, Angle
rotate = Rotate(Geometry=vec2pt.Vector, Angle=1.570796327, Plane=PlaneXY(0, 0, 0))  # -> Geometry, Transform

# ---- group: 保证两条流输出点秩一致？
rotate_2 = Rotate(Geometry=align.Plane, Angle=1.570796327, Plane=align.Plane)  # -> Geometry, Transform

# ----
pl = ConstructPlane(Origin=Point(0, 0, 0), XAxis=vec2pt.Vector, YAxis=rotate.Geometry)
bbox = BoundingBox(Content=crv, Plane=pl)  # -> Box, Box_2
bbox_2 = BoundingBox(Content=crv, Plane=rotate_2.Geometry)  # -> Box, Box_2
debrep = DeconstructBrep(Brep=bbox.Box)  # -> Faces, Edges, Vertices
debrep_2 = DeconstructBrep(Brep=bbox_2.Box)  # -> Faces, Edges, Vertices
B = ClusterInput()  # 是否启动最长边矫正算法
pline = PolyLine(Vertices=debrep.Vertices, Closed=True)
pline_2 = PolyLine(Vertices=debrep_2.Vertices, Closed=True)
filter = StreamFilter(Gate=B, Stream0=pline, Stream1=pline_2)
fp2d = FlipcurvePLus2D_2(C=filter)
crv_2 = Curve(fp2d)
R = ClusterOutput(crv_2)  # 依据心态生成旋转的矩形线框

# ==== cluster 切割线框: Input： S-输入一个闭合线框 C-输入切割用曲线 Output C-输出切好的闭合线框 //偶而切割失败 //V1.5 skywoolf 190617
# 作者：Skywoolf
# NCF参数化建筑联盟：bbs.ncf-china.com
# NCFZ数字设计平台：ncf.cz-studio.com
# 相关书籍：《Grasshopper参数化设计教程》--“数字冥想”
# 共同维护知识产权平台，请勿删除。感谢您对国人设计技术原创的支持！
# 开发日志：
# 190620：测试版封装
# //目前依赖于曲面切割算法，这样比较占资源，有待优化
# 
# //单个数据成功运算结果：正常
# //树形数据测试结果：正常
R = ClusterInput()  # 待切分的区域
crv = Curve(R)
boundary = BoundarySurfaces(Edges=crv)
C = ClusterInput()  # 切分用的曲线
# 祁鹏远 -- NCF站长；C+Z合伙人建筑师
srfsplit = SurfaceSplit(Surface=boundary, Curves=C)
wires = BrepWireframe(Brep=srfsplit, Density=-1)
join = JoinCurves(Curves=wires, Preserve=False)  # -> simplify(Curves)
ttp = TrimTreePlus(T=join, D=1)
sp = SimplifyPlus(T=ttp)
crv_2 = Curve(sp)
R_2 = ClusterOutput(crv_2)  # 切分后的线框

# ==== cluster 判断闭合
crv = ClusterInput()
crv_2 = Curve(crv)
cls = Closed(Curve=crv_2)  # -> Closed, Periodic
dispatch = Dispatch(List=crv_2, DispatchPattern=cls.Closed)  # -> ListA, ListB
divide = DivideCurve(Curve=dispatch.ListA, Count=10, Kinks=False)  # -> Points, Tangents, Parameters
shatter = Shatter(Curve=dispatch.ListA, Parameters=divide.Parameters)
shift = ShiftList(List=shatter, Shift=-1, Wrap=True)
sp = SimplifyPlus(T=graft(shatter))
sp_2 = SimplifyPlus(T=graft(shift))
join = JoinCurves(Curves=[sp, sp_2], Preserve=False)
sp_3 = SimplifyPlus(T=join)
relay = ClusterInput()
sp_4 = SimplifyPlus(T=dispatch.ListB)
ttp = TrimTreePlus(T=sp_3, D=1)
merge = Merge(Data1=ttp, Data2=sp_4)
offset = OffsetCurve(Curve=merge, Distance=expr("-x", relay), Plane=PlaneXY(0, 0, 0), Corners=1)
offset_2 = OffsetCurve(Curve=merge, Distance=relay, Plane=PlaneXY(0, 0, 0), Corners=1)
end = EndPoints(Curve=offset_2)  # -> Start, End
end_2 = EndPoints(Curve=offset)  # -> Start, End
ln = Line(StartPoint=end_2.Start, EndPoint=end.Start)
ln_2 = Line(StartPoint=end_2.End, EndPoint=end.End)
merge_2 = Merge(Data1=offset, Data2=ln, Data3=offset_2, Data4=ln_2)
join_2 = JoinCurves(Curves=merge_2, Preserve=False)  # -> simplify(Curves)
ttp_2 = TrimTreePlus(T=join_2, D=1)
ma = MassAddition(Input=flatten(cls.Closed))  # -> Result, PartialResults
runion = RegionUnion(Curves=ttp_2)
crv_3 = Curve(runion)
bool = Boolean(ma.Result)
crv_4 = ClusterOutput(crv_3)
bool_2 = ClusterOutput(bool)

# ==== cluster Cluster_4: 将一个线框随机切成两个 V1.0 skywoolf 190621
# 作者：Skywoolf
# NCF参数化建筑联盟：bbs.ncf-china.com
# NCFZ数字设计平台：ncf.cz-studio.com
# 相关书籍：《Grasshopper参数化设计教程》--“数字冥想”
# 共同维护知识产权平台，请勿删除。感谢您对国人设计技术原创的支持！
# 控制随机分割的区间，避免出现过小或过大的分割
R = ClusterInput()  # 需要分割的线框
# 开发日志：
# 190621：测试版封装
# //将一个线框随机一分为二，循环此算法，可以不断分割的更细
# 
# //下一步优化：
# 1、循环算法优化；
# 
# //评估测试：
# 1、独立闭合线框录入：正常
# 2、多个闭合线框录入：正常
panel = Panel("0.2 to 0.7")
crv = Curve(graft(R))
lng = ListLength(List=flatten(crv))
S = ClusterInput()
explode = Explode(Curve=crv, Recursive=True)  # -> Segments, Vertices
random = Random(Range=panel, Number=lng, Seed=S)  # -> graft(Random)
# 祁鹏远 -- NCF站长；C+Z合伙人建筑师
ll = LongestLine(C=explode.Segments)  # -> cl, cs
unflatten = UnflattenTree(Tree=random, Guide=ll.cl)
pframe = PerpFrame(Curve=reparameterize(ll.cl), Parameter=unflatten)
pcx = CurvePlane(Curve=graft(crv), Plane=pframe)  # -> Points, ParamsC, ParamsP
sort_pt = SortPoints(Points=pcx.Points)  # -> Points, Indices
pline = PolyLine(Vertices=sort_pt.Points, Closed=False)
xy = XYPlane(Origin=Point(0, 0, 0))
cluster = Cluster_3(crv=pline, crv_2=crv, pln=xy)
sp = SimplifyPlus(T=cluster)
cc = 切割线框_2(R=crv, C=sp)
fp2d = FlipcurvePLus2D_3(C=cc)
ttp = TrimTreePlus_3(T=fp2d, D=1, F=0)
ttp_2 = TrimTreePlus_3(T=cluster, D=1, F=0)
crv_2 = Curve(ttp)
crv_3 = Curve(ttp_2)
R_2 = ClusterOutput(crv_2)  # 分割后的线框
C = ClusterOutput(crv_3)  # 生成分割线

# ==== cluster 分类用地
用地 = ClusterInput()
面积判断 = 面积判断(crv=用地, B="500")  # -> A, B_2
预留最小 = 预留最小(crv=面积判断.A, int="0")  # -> crv_5, crv_6
狭长判断 = 狭长判断(crv=预留最小.crv_5, B="5")  # -> A, B_2
狭长判断_2 = 狭长判断(crv=狭长判断.B_2, B="2.5")  # -> A, B_2
面积判断_2 = 面积判断(crv=狭长判断_2.B_2, B="4000")  # -> A, B_2
面积判断_3 = 面积判断(crv=面积判断_2.B_2, B="1500")  # -> A, B_2
过大用地 = ClusterOutput(面积判断_2.A)
过长用地 = ClusterOutput(狭长判断_2.A)
较小用地 = ClusterOutput(面积判断_3.B_2)
适中用地 = ClusterOutput(面积判断_3.A)
merge = Merge(Data1=面积判断.B_2, Data2=预留最小.crv_6, Data3=狭长判断.A)  # -> flatten(Result)
不良用地 = ClusterOutput(merge)

# ==== cluster 容积率校对
crv = ClusterInput()
crv_2 = Curve(flatten(crv))

# ---- group: 个别面积统计失败bug / 偶遇bug修复
area = Area(Geometry=crv_2)  # -> Area, Centroid

# ---- group: 个别面积统计失败bug
null = NullItem(Item=area.Centroid)  # -> NullFlags, InvalidFlags, Description
dispatch = Dispatch(List=crv_2, DispatchPattern=null.NullFlags)  # -> ListA, ListB
index = ItemIndex(List=crv_2, Item=dispatch.ListA)
item = ListItem(List=crv_2, Index=index, Wrap=True)
fit = FitCurve(Curve=item)

# ----
用地红线 = ClusterInput()
cull_i = CullIndex(List=crv_2, Indices=index, Wrap=True)
crv_3 = Curve(用地红线)
merge = Merge(Data1=cull_i, Data2=fit)  # -> flatten(Result)
area_2 = Area(Geometry=crv_3)  # -> Area, Centroid
ma = MassAddition(Input=flatten(area_2.Area))  # -> Result, PartialResults
area_3 = Area(Geometry=merge)  # -> Area, Centroid
split = TextSplit(Text=ma.Result, Separators=",")
pdecon = Deconstruct(Point=area_3.Centroid)  # -> XComponent, YComponent, ZComponent
panel = Panel(split)
item_2 = ListItem(List=split, Index=0, Wrap=True)  # -> Item, Item1
B = ClusterInput()
lng = ListLength(List=pdecon.ZComponent)
series = Series(Start=0, Step=1, Count=lng)
multiplication = Multiplication(A=item_2.Item1, B=B)
panel_2 = Panel(multiplication)
sort = SortList(Keys=pdecon.ZComponent, ValuesA=series)  # -> Keys, ValuesA
item_3 = ListItem(List=merge, Index=sort.ValuesA, Wrap=True)
item_4 = ListItem(List=area_3.Area, Index=sort.ValuesA, Wrap=True)
ma_2 = MassAddition(Input=item_4)  # -> Result, PartialResults
smaller = SmallerThan(FirstNumber=ma_2.PartialResults, SecondNumber=panel_2)  # -> SmallerThan, OrEqualTo
cull = CullPattern(List=item_3, CullPattern=smaller.SmallerThan)
crv_4 = Curve(cull)
area_4 = Area(Geometry=crv_4)  # -> Area, Centroid

pdecon_2 = Deconstruct(Point=area_4.Centroid)  # -> XComponent, YComponent, ZComponent
eval = Evaluate(F="x*y-x/y", x=pdecon_2.XComponent, y=pdecon_2.YComponent)
cset = CreateSet(List=eval)  # -> graft(Set), Map
equals = Equality(FirstNumber=eval, SecondNumber=cset.Set)  # -> Equality, Inequality

ma_3 = MassAddition(Input=flatten(area_4.Area))  # -> Result, PartialResults
division = Division(A=ma_3.Result, B=item_2.Item1)
R = ClusterOutput(division)
cull_2 = CullPattern(List=crv_4, CullPattern=equals.Equality)
lng_2 = ListLength(List=cull_2)
item_5 = ListItem(List=cull_2, Index=expr("x-1", lng_2), Wrap=True)
Z = UnitZ(Factor=5)
move = Move(Geometry=item_5, Motion=Z)  # -> Geometry, Transform
merge_2 = Merge(Data1=cull_2, Data2=move.Geometry)
R_2 = ClusterOutput(merge_2)

# ==== cluster 切分排楼
用地 = ClusterInput()
切分用地 = 切分用地(crv=用地)
fp2d = Flip2DCurvePro(crv=切分用地)
cluster = Cluster_5(crv=fp2d, relay=Slider(3, range=0..10))
层数 = Slider(2, range=0..10)
面积判断 = 面积判断(crv=cluster, B="200")  # -> A, B_2
series = Series(Start=0, Step=4.5, Count=层数)
Z = UnitZ(Factor=series)
move = Move(Geometry=面积判断.A, Motion=Z)  # -> Geometry, Transform
clean = CleanTree(RemoveNulls=True, RemoveInvalid=True, RemoveEmpty=True, Tree=move.Geometry)  # -> simplify(Tree)
item = ListItem(List=clean, Index=0, Wrap=True)
T = ClusterOutput(clean)
subtraction = Subtraction(A=层数, B=1)
area = Area(Geometry=item)  # -> Area, Centroid
multiplication = Multiplication(A=area.Area, B=subtraction)  # -> simplify(Result)
clean_2 = CleanTree(RemoveNulls=True, RemoveInvalid=True, RemoveEmpty=True, Tree=面积判断.B_2)  # -> simplify(Tree)
path_mapper = PathMapper(multiplication, source=["{A}", "{A;B}", "{A;B;C}", "{A;B;C;D}"], target=["{A}", "{A}", "{A}", "{A}"])
path_mapper_2 = PathMapper(clean_2, source=["{A}", "{A;B}", "{A;B;C}", "{A;B;C;D}"], target=["{A}", "{A}", "{A}", "{A}"])
path_mapper_3 = ClusterOutput(path_mapper)
path_mapper_4 = ClusterOutput(path_mapper_2)

# ==== cluster 高层建筑
C = ClusterInput()
层数 = Slider(100, range=0..100)
fp2d = Flip2DCurvePro(crv=C)
cluster = Cluster_5(crv=fp2d, relay=Slider(6, range=0..10))
series = Series(Start=0, Step=3.5, Count=层数)
Z = UnitZ(Factor=series)
move = Move(Geometry=cluster, Motion=Z)  # -> Geometry, Transform
clean = CleanTree(RemoveNulls=True, RemoveInvalid=True, RemoveEmpty=True, Tree=move.Geometry)  # -> simplify(Tree)
item = ListItem(List=clean, Index=0, Wrap=True)
area = Area(Geometry=item)  # -> Area, Centroid
path_mapper = PathMapper(clean, source=["{A}", "{A;B}", "{A;B;C}", "{A;B;C;D}"], target=["{A}", "{A}", "{A}", "{A}"])
subtraction = Subtraction(A=层数, B=1)
multiplication = Multiplication(A=area.Area, B=subtraction)  # -> simplify(Result)
path_mapper_2 = ClusterOutput(path_mapper)
path_mapper_3 = PathMapper(multiplication, source=["{A}", "{A;B}", "{A;B;C}", "{A;B;C;D}"], target=["{A}", "{A}", "{A}", "{A}"])
path_mapper_4 = ClusterOutput(path_mapper_3)

# ==== cluster 独立建筑
C = ClusterInput()
层数 = Slider(3, range=0..10)
fp2d = Flip2DCurvePro(crv=C)

# ---- group: 个别曲线偏移有bug
boundary = BoundarySurfaces(Edges=fp2d)

# ----
cluster = Cluster_5(crv=boundary, relay=Slider(3, range=0..10))
series = Series(Start=0, Step=6, Count=层数)
Z = UnitZ(Factor=series)
move = Move(Geometry=cluster, Motion=Z)  # -> Geometry, Transform
clean = CleanTree(RemoveNulls=True, RemoveInvalid=True, RemoveEmpty=True, Tree=move.Geometry)  # -> simplify(Tree)
area = Area(Geometry=cluster)  # -> Area, Centroid
subtraction = Subtraction(A=层数, B=1)
path_mapper = PathMapper(clean, source=["{A}", "{A;B}", "{A;B;C}", "{A;B;C;D}"], target=["{A}", "{A}", "{A}", "{A}"])
multiplication = Multiplication(A=area.Area, B=subtraction)  # -> simplify(Result)
path_mapper_2 = PathMapper(multiplication, source=["{A}", "{A;B}", "{A;B;C}", "{A;B;C;D}"], target=["{A}", "{A}", "{A}", "{A}"])
path_mapper_3 = ClusterOutput(path_mapper)
path_mapper_4 = ClusterOutput(path_mapper_2)

# ==== cluster 组合排楼
C = ClusterInput()
fp2d = Flip2DCurvePro(crv=C)
cluster = Cluster_5(crv=fp2d, relay=Slider(7, range=0..10))
bb2 = BoundBox2(crv=cluster, G=0)
substrate = Substrate(Border=bb2, Count=Slider(2, range=0..10), Angles=0, Deviation=0, Seed=5)
ac = AreaCutting_2(E=cluster, C=substrate)
层数 = Slider(6, range=0..10)
层数_2 = Slider(3, range=0..10)
预留最小 = 预留最小_2(crv=ac, int="0")  # -> L, crv_4
item = ListItem(List=预留最小.L, Index=0, Wrap=True)  # -> Item, Item1
series = Series(Start=0, Step=5, Count=层数)
series_2 = Series(Start=0, Step=5, Count=层数_2)
Z = UnitZ(Factor=series)
Z_2 = UnitZ(Factor=series_2)
subtraction = Subtraction(A=层数_2, B=1)
subtraction_2 = Subtraction(A=层数, B=1)
move = Move(Geometry=item.Item, Motion=Z)  # -> Geometry, Transform
move_2 = Move(Geometry=item.Item1, Motion=Z_2)  # -> Geometry, Transform
clean = CleanTree(RemoveNulls=True, RemoveInvalid=True, RemoveEmpty=True, Tree=move.Geometry)  # -> simplify(Tree)
item_2 = ListItem(List=clean, Index=0, Wrap=True)
area = Area(Geometry=item_2)  # -> Area, Centroid
multiplication = Multiplication(A=area.Area, B=subtraction_2)  # -> simplify(Result)
clean_2 = CleanTree(RemoveNulls=True, RemoveInvalid=True, RemoveEmpty=True, Tree=move_2.Geometry)  # -> simplify(Tree)
item_3 = ListItem(List=clean_2, Index=0, Wrap=True)
area_2 = Area(Geometry=item_3)  # -> Area, Centroid
multiplication_2 = Multiplication(A=area_2.Area, B=subtraction)  # -> simplify(Result)
clean_3 = CleanTree(RemoveNulls=True, RemoveInvalid=True, RemoveEmpty=True, Tree=预留最小.crv_4)  # -> simplify(Tree)
addition = Addition(A=multiplication, B=multiplication_2)
path_mapper = PathMapper(clean_3, source=["{A}", "{A;B}", "{A;B;C}", "{A;B;C;D}"], target=["{A}", "{A}", "{A}", "{A}"])
path_mapper_2 = PathMapper(clean, source=["{A}", "{A;B}", "{A;B;C}", "{A;B;C;D}"], target=["{A}", "{A}", "{A}", "{A}"])
path_mapper_3 = PathMapper(addition, source=["{A}", "{A;B}", "{A;B;C}", "{A;B;C;D}"], target=["{A}", "{A}", "{A}", "{A}"])
path_mapper_4 = PathMapper(clean_2, source=["{A}", "{A;B}", "{A;B;C}", "{A;B;C;D}"], target=["{A}", "{A}", "{A}", "{A}"])
path_mapper_5 = ClusterOutput(path_mapper_2)
path_mapper_6 = ClusterOutput(path_mapper_4)
path_mapper_7 = ClusterOutput(path_mapper_3)
path_mapper_8 = ClusterOutput(path_mapper)

# ==== cluster UnityOfDirection_2
crv = ClusterInput()

panel = Panel("""统一曲线的方向

成逆时针方向

即参数为正数时向外偏移""")
crv_2 = Curve(crv)
explode = Explode(Curve=crv_2, Recursive=True)  # -> Segments, Vertices
cull_i = CullIndex(List=explode.Vertices, Indices=0, Wrap=True)
avr = Average(Input=cull_i)
# 没有graft多条线会报错
cir = Circle(Plane=avr, Radius=1)
flip = FlipCurve(Curve=graft(crv_2), Guide=cir)  # -> simplify(Curve), Flag

C = ClusterOutput(flip.Curve)

# ==== cluster 外环排车位
C = ClusterInput()

# ---- group: 选出道路外边线直线段
explode = Explode(Curve=C, Recursive=True)  # -> simplify(Segments), Vertices

# ----
len = Length(Curve=explode.Segments)
smaller = SmallerThan(FirstNumber=len, SecondNumber=22)  # -> SmallerThan, OrEqualTo
dispatch = Dispatch(List=explode.Segments, DispatchPattern=smaller.SmallerThan)  # -> ListA, ListB

# ---- group: 选出道路外边线直线段 (continued)
crv = Curve(dispatch.ListB)

# ----
divlength = DivideLength(Curve=crv, Length="5.5")  # -> Points, Tangents, Parameters
lng = ListLength(List=divlength.Parameters)
lng_2 = ListLength(List=divlength.Tangents)
cull_i = CullIndex(List=divlength.Parameters, Indices=expr("x-1", lng), Wrap=True)
cull_i_2 = CullIndex(List=divlength.Tangents, Indices=expr("x-1", lng_2), Wrap=True)
shatter = Shatter(Curve=graft(crv), Parameters=cull_i)  # -> simplify(Segments)
rotate = Rotate(Geometry=cull_i_2, Angle=-1.570796327, Plane=PlaneXY(0, 0, 0))  # -> Geometry, Transform
end = EndPoints(Curve=shatter)  # -> Start, End
line = LineSDL(Start=end.Start, Direction=rotate.Geometry, Length=1)
end_2 = EndPoints(Curve=line)  # -> Start, End
pl_3pt = Plane3Pt(PointA=end.Start, PointB=end.End, PointC=end_2.End)

dom = ConstructDomain(DomainStart=0, DomainEnd="5.5")
P = Plane(PlaneXY(0, 0, 0))
rectangle = Rectangle(Plane=P, XSize=dom, YSize=Domain(0, 2.5), Radius=0)  # -> Rectangle, Length
orient = Orient(Geometry=rectangle.Rectangle, Source=P, Target=pl_3pt)  # -> Geometry, Transform
crv_2 = Curve(orient.Geometry)

lng_3 = ListLength(List=crv_2)
subtraction = Subtraction(A=lng_3, B=[1, 2])
cull_i_3 = CullIndex(List=crv_2, Indices=subtraction, Wrap=True)
cull_i_4 = CullIndex(List=cull_i_3, Indices=[0, 1], Wrap=True)
外环车位 = Curve(flatten(cull_i_4))
lng_4 = ListLength(List=外环车位)
外环车位_2 = ClusterOutput(外环车位)
L = ClusterOutput(lng_4)

# ==== cluster FlipcurvePLus2D: 统一曲线的方向为逆时针旋转；用于部分运算器输出曲线方向不一致的问题； Input： C-原始曲线； Output： C-方向统一后的曲线； //直线目前不适合该电池； //本版适合于平面曲线； //V2.1 skywoolf 190617
# 作者：Skywoolf
# NCF参数化建筑联盟：bbs.ncf-china.com
# NCFZ数字设计平台：ncf.cz-studio.com
# 相关书籍：《Grasshopper参数化设计教程》--“数字冥想”
# 共同维护知识产权平台，请勿删除。感谢您对国人设计技术原创的支持！
C = ClusterInput()  # 需要统一方向的曲线
crv = Curve(C)
# 祁鹏远 -- NCF站长；C+Z合伙人建筑师
explode = Explode(Curve=crv, Recursive=True)  # -> Segments, Vertices
P = ClusterInput()  # 参考哪个平面进行运算
# 开发日志：
# 190620：测试版封装
# //统一平面曲线的方向，在考虑保留这个运算器的必要性；
# //此运算器对line无效；
# 
# //单个数据成功运算结果：正常
# //Longlist法则测试结果：正常
# //树形数据测试结果：正常
xy = XYPlane(Origin=Point(0, 0, 0))
cull_i = CullIndex(List=explode.Vertices, Indices=0, Wrap=True)
dd = DefaultData(I=P, D=xy)
avr = Average(Input=cull_i)
pl_origin = PlaneOrigin(Base=dd, Origin=avr)
cir = Circle(Plane=pl_origin, Radius=1)
flip = FlipCurve(Curve=graft(crv), Guide=cir)  # -> simplify(Curve), Flag
crv_2 = Curve(flip.Curve)
# 不适合于单条线段
# 仅限于平面线条
# 没有graft多条线会报错
C_2 = ClusterOutput(crv_2)  # 统一方向后的曲面

# ==== cluster LongestLine: 输入一组曲线，判断最长线和最短线； Input： C-输入的曲线； Output Cl-最长的线 Cs-最短的线 //V2.0 skywoolf 190617
# 作者：Skywoolf
# NCF参数化建筑联盟：bbs.ncf-china.com
# NCFZ数字设计平台：ncf.cz-studio.com
# 相关书籍：《Grasshopper参数化设计教程》--“数字冥想”
# 共同维护知识产权平台，请勿删除。感谢您对国人设计技术原创的支持！
# 开发日志：
# 190620：测试版封装
# //除了求最长最短边以外，这个算法对矩形长短边的提取进行了优化，在同时出现多个长边的适合，自动选取靠近矩形闭合点位置的线条；
# 
# //单个数据成功运算结果：正常
# //树形数据测试结果：正常
C = ClusterInput()  # 一组多个曲线的数据
crv = Curve(C)
len = Length(Curve=crv)
bnd = Bounds(Numbers=len)
dedomain = DeconstructDomain(Domain=bnd)  # -> Start, End
similar = Similarity(FirstNumber=len, SecondNumber=dedomain.Start, Threshold=0.1)  # -> Similarity, AbsoluteDifference
similar_2 = Similarity(FirstNumber=len, SecondNumber=dedomain.End, Threshold=0.1)  # -> Similarity, AbsoluteDifference
cull = CullPattern(List=crv, CullPattern=similar_2.Similarity)

# ---- group: 等长多条线时，选择靠近此点的
# 祁鹏远 -- NCF站长；C+Z合伙人建筑师
curvepoint = PointOnCurve(crv, parameter=0.5)
item = ListItem(List=curvepoint, Index=0, Wrap=True)  # -> Item, Item1
avr = Average(Input=[item.Item, item.Item1])
crv_cp = CurveClosestPoint(Point=avr, Curve=cull)  # -> Point, Parameter, Distance

# ----
cull_2 = CullPattern(List=crv, CullPattern=similar.Similarity)
crv_cp_2 = CurveClosestPoint(Point=avr, Curve=cull_2)  # -> Point, Parameter, Distance
bnd_2 = Bounds(Numbers=crv_cp_2.Distance)
bnd_3 = Bounds(Numbers=crv_cp.Distance)
dedomain_2 = DeconstructDomain(Domain=bnd_2)  # -> Start, End
dedomain_3 = DeconstructDomain(Domain=bnd_3)  # -> Start, End
equals = Equality(FirstNumber=crv_cp_2.Distance, SecondNumber=dedomain_2.Start)  # -> Equality, Inequality
equals_2 = Equality(FirstNumber=crv_cp.Distance, SecondNumber=dedomain_3.Start)  # -> Equality, Inequality
cull_3 = CullPattern(List=cull, CullPattern=equals_2.Equality)
cull_4 = CullPattern(List=cull_2, CullPattern=equals.Equality)
crv_2 = Curve(cull_3)
crv_3 = Curve(cull_4)
cl = ClusterOutput(crv_2)  # 最长的一条曲线
cs = ClusterOutput(crv_3)  # 最短的一条曲线

# ==== cluster FlipcurvePLus2D_2: 统一曲线的方向为逆时针旋转；用于部分运算器输出曲线方向不一致的问题； Input： C-原始曲线； Output： C-方向统一后的曲线； //直线目前不适合该电池； //本版适合于平面曲线； //V2.1 skywoolf 190617
# 作者：Skywoolf
# NCF参数化建筑联盟：bbs.ncf-china.com
# NCFZ数字设计平台：ncf.cz-studio.com
# 相关书籍：《Grasshopper参数化设计教程》--“数字冥想”
# 共同维护知识产权平台，请勿删除。感谢您对国人设计技术原创的支持！
C = ClusterInput()  # 需要统一方向的曲线
crv = Curve(C)
# 祁鹏远 -- NCF站长；C+Z合伙人建筑师
explode = Explode(Curve=crv, Recursive=True)  # -> Segments, Vertices
P = ClusterInput()  # 参考哪个平面进行运算
# 开发日志：
# 190620：测试版封装
# //统一平面曲线的方向，在考虑保留这个运算器的必要性；
# //此运算器对line无效；
# 
# //单个数据成功运算结果：正常
# //Longlist法则测试结果：正常
# //树形数据测试结果：正常
xy = XYPlane(Origin=Point(0, 0, 0))
cull_i = CullIndex(List=explode.Vertices, Indices=0, Wrap=True)
dd = DefaultData(I=P, D=xy)
avr = Average(Input=cull_i)
pl_origin = PlaneOrigin(Base=dd, Origin=avr)
cir = Circle(Plane=pl_origin, Radius=1)
flip = FlipCurve(Curve=graft(crv), Guide=cir)  # -> simplify(Curve), Flag
# 不适合于单条线段
# 仅限于平面线条
# 没有graft多条线会报错
C_2 = ClusterOutput(flip.Curve)  # 统一方向后的曲面

# ==== cluster TrimTreePlus: Trim Tree的升级版，原生电池中的Trim Tree可以说是用来将树形数据降级的最佳选择，通常情况下，它可以保证这条数据流的联动性，当前端数据结构发生变化时，后端不会挂掉。但是，对于只有一级路径名的树形数据，Trim Tree会直接将其砍至没有数据，这种情况会导致我们在打包Cluster的适合，输入端出现无法兼容单个数据和树形数据的bug。所以为了强大Cluster对输入端数据结构的适应能力，我们对Trim Tree的规则做了小小的改进：当T端输入只有一级路径的分组数据时，输出的结果从不输出改为：输出拍平后的数据。这样可以在大多数Cluster能适应对输入不同格式的数据结构； //V1.3 skywoolf 190617 //个别情况下T端要输出的时拍平数据，而不是分组数据，此时该电池并不适用；
# 作者：Skywoolf
# NCF参数化建筑联盟：bbs.ncf-china.com
# NCFZ数字设计平台：ncf.cz-studio.com
# 相关书籍：《Grasshopper参数化设计教程》--“数字冥想”
# 共同维护知识产权平台，请勿删除。感谢您对国人设计技术原创的支持！
T = ClusterInput()  # 待砍级的数据
# 开发日志：
# 190620：测试版封装
# //开发它的原因是因为大部分复杂Cluster的输入端无法做到单个数据和树形数据的兼容，往往树形数据可以运算的适合，连接单个数据就会报bug；
# //有一种特殊情况目前出现的比较少，所以没有考虑：部分运算在Gate1那里不拍平会呈现预想的兼容效果；
# 
# //单个数据成功运算结果：正常
# //Longlist法则测试结果：正常
# //树形数据测试结果：正常
D = ClusterInput()  # 要看去几级路径名
F = ClusterInput()  # 对仅剩一级的树形数据是否做拍平处理
data = Data(T)
int = Integer(D)
dd = DefaultData(I=F, D="1")
trim = TrimTree(Tree=data, Depth=int)
data_2 = Data(flatten(data))
# 祁鹏远 -- NCF站长；C+Z合伙人建筑师
filter = StreamFilter(Gate=dd, Stream0=data, Stream1=data_2)
null = NullItem(Item=trim)  # -> NullFlags, InvalidFlags, Description
item = ListItem(List=flatten(null.NullFlags), Index=0, Wrap=True)
filter_2 = StreamFilter(Gate=item, Stream0=trim, Stream1=filter)
data_3 = Data(filter_2)
T_2 = ClusterOutput(data_3)  # 砍完路径名后的数据

# ==== cluster FlipcurvePLus2D_3: 统一曲线的方向为逆时针旋转；用于部分运算器输出曲线方向不一致的问题； Input： C-原始曲线； Output： C-方向统一后的曲线； //直线目前不适合该电池； //本版适合于平面曲线； //V2.1 skywoolf 190617
# 作者：Skywoolf
# NCF参数化建筑联盟：bbs.ncf-china.com
# NCFZ数字设计平台：ncf.cz-studio.com
# 相关书籍：《Grasshopper参数化设计教程》--“数字冥想”
# 共同维护知识产权平台，请勿删除。感谢您对国人设计技术原创的支持！
C = ClusterInput()  # 需要统一方向的曲线
crv = Curve(C)
# 祁鹏远 -- NCF站长；C+Z合伙人建筑师
explode = Explode(Curve=crv, Recursive=True)  # -> Segments, Vertices
P = ClusterInput()  # 参考哪个平面进行运算
# 开发日志：
# 190620：测试版封装
# //统一平面曲线的方向，在考虑保留这个运算器的必要性；
# //此运算器对line无效；
# 
# //单个数据成功运算结果：正常
# //Longlist法则测试结果：正常
# //树形数据测试结果：正常
xy = XYPlane(Origin=Point(0, 0, 0))
cull_i = CullIndex(List=explode.Vertices, Indices=0, Wrap=True)
dd = DefaultData(I=P, D=xy)
avr = Average(Input=cull_i)
pl_origin = PlaneOrigin(Base=dd, Origin=avr)
cir = Circle(Plane=pl_origin, Radius=1)
flip = FlipCurve(Curve=graft(crv), Guide=cir)  # -> simplify(Curve), Flag
ttp = TrimTreePlus_2(T=flip.Curve, D=1)
match = MatchTree(Tree=ttp, Guide=crv)
crv_2 = Curve(match)
# 不适合于单条线段
# 仅限于平面线条
# 没有graft多条线会报错
C_2 = ClusterOutput(crv_2)  # 统一方向后的曲面

# ==== cluster 切割线框_2: Input： S-输入一个闭合线框 C-输入切割用曲线 Output C-输出切好的闭合线框 //偶而切割失败 //V1.5 skywoolf 190617
# 作者：Skywoolf
# NCF参数化建筑联盟：bbs.ncf-china.com
# NCFZ数字设计平台：ncf.cz-studio.com
# 相关书籍：《Grasshopper参数化设计教程》--“数字冥想”
# 共同维护知识产权平台，请勿删除。感谢您对国人设计技术原创的支持！
R = ClusterInput()  # 待切分的区域
# 开发日志：
# 190620：测试版封装
# //目前依赖于曲面切割算法，这样比较占资源，有待优化
# 
# //单个数据成功运算结果：正常
# //树形数据测试结果：正常
C = ClusterInput()  # 切分用的曲线
crv = Curve(R)
boundary = BoundarySurfaces(Edges=crv)
crv_2 = Curve(C)
# 祁鹏远 -- NCF站长；C+Z合伙人建筑师
srfsplit = SurfaceSplit(Surface=boundary, Curves=crv_2)
wires = BrepWireframe(Brep=srfsplit, Density=-1)
join = JoinCurves(Curves=wires, Preserve=False)  # -> simplify(Curves)
ttp = TrimTreePlus(T=join, D=1)
match = MatchTree(Tree=ttp, Guide=crv)
crv_3 = Curve(match)
R_2 = ClusterOutput(crv_3)  # 切分后的线框

# ==== cluster TrimTreePlus_3: Trim Tree的升级版，原生电池中的Trim Tree可以说是用来将树形数据降级的最佳选择，通常情况下，它可以保证这条数据流的联动性，当前端数据结构发生变化时，后端不会挂掉。但是，对于只有一级路径名的树形数据，Trim Tree会直接将其砍至没有数据，这种情况会导致我们在打包Cluster的适合，输入端出现无法兼容单个数据和树形数据的bug。所以为了强大Cluster对输入端数据结构的适应能力，我们对Trim Tree的规则做了小小的改进：当T端输入只有一级路径的分组数据时，输出的结果从不输出改为：输出拍平后的数据。这样可以在大多数Cluster能适应对输入不同格式的数据结构； //V1.3 skywoolf 190617 //V1.4 skywoolf 190626 //个别情况下T端要输出的时拍平数据，而不是分组数据，此时该电池并不适用；
# 作者：Skywoolf
# NCF参数化建筑联盟：bbs.ncf-china.com
# NCFZ数字设计平台：ncf.cz-studio.com
# 相关书籍：《Grasshopper参数化设计教程》--“数字冥想”
# 共同维护知识产权平台，请勿删除。感谢您对国人设计技术原创的支持！
T = ClusterInput()  # 待砍级的数据
D = ClusterInput()  # 要看去几级路径名
# 开发日志：
# 190620：测试版封装
# //开发它的原因是因为大部分复杂Cluster的输入端无法做到单个数据和树形数据的兼容，往往树形数据可以运算的适合，连接单个数据就会报bug；
# //有一种特殊情况目前出现的比较少，所以没有考虑：部分运算在Gate1那里不拍平会呈现预想的兼容效果；
# 
# //单个数据成功运算结果：正常
# //Longlist法则测试结果：正常
# //树形数据测试结果：正常
F = ClusterInput()  # 对仅剩一级的树形数据是否做拍平处理
data = Data(T)
int = Integer(D)
dd = DefaultData(I=F, D="1")
trim = TrimTree(Tree=data, Depth=int)
data_2 = Data(flatten(data))
# 祁鹏远 -- NCF站长；C+Z合伙人建筑师
filter = StreamFilter(Gate=dd, Stream0=data, Stream1=data_2)
null = NullItem(Item=trim)  # -> NullFlags, InvalidFlags, Description
item = ListItem(List=flatten(null.NullFlags), Index=0, Wrap=True)
filter_2 = StreamFilter(Gate=item, Stream0=trim, Stream1=filter)
data_3 = Data(filter_2)
T_2 = ClusterOutput(data_3)  # 砍完路径名后的数据

# ==== cluster Cluster_3
crv = ClusterInput()
crv_2 = ClusterInput()
pln = ClusterInput()
crv_3 = Curve(simplify(crv))
crv_4 = Curve(crv_2)
pln_2 = Plane(pln)
trim = TrimWithRegion(Curve=crv_3, Region=crv_4, Plane=pln_2)  # -> Inside, Outside
curvepoint = PointOnCurve(trim.Inside, parameter=0.5)
incurve = PointInCurve(Point=curvepoint, Curve=crv_4)  # -> Relationship, Point
cull = CullPattern(List=trim.Inside, CullPattern=incurve.Relationship)
sp = SimplifyPlus_2(T=cull)
match = MatchTree(Tree=sp, Guide=crv_4)
T = ClusterOutput(match)

# ==== cluster 面积判断
crv = ClusterInput()
panel = Panel("根据面积筛选用地")
crv_2 = Curve(crv)
area = Area(Geometry=crv_2)  # -> Area, Centroid
B = ClusterInput()
larger = LargerThan(FirstNumber=area.Area, SecondNumber=B)  # -> LargerThan, OrEqualTo
dispatch = Dispatch(List=crv_2, DispatchPattern=larger.LargerThan)  # -> simplify(ListA), simplify(ListB)
A = ClusterOutput(dispatch.ListA)
B_2 = ClusterOutput(dispatch.ListB)

# ==== cluster 预留最小
crv = ClusterInput()
crv_2 = Curve(crv)
area = Area(Geometry=crv_2)  # -> Area, Centroid
lng = ListLength(List=area.Area)
series = Series(Start=0, Step=1, Count=lng)
sort = SortList(Keys=area.Area, ValuesA=series)  # -> Keys, ValuesA
int = ClusterInput()
item = ListItem(List=crv_2, Index=sort.ValuesA, Wrap=True)
int_2 = Integer(int)
cull_i = CullIndex(List=item, Indices=int_2, Wrap=True)  # -> simplify(List)
item_2 = ListItem(List=item, Index=int_2, Wrap=True)  # -> simplify(Item)
crv_3 = Curve(cull_i)
crv_4 = Curve(item_2)
crv_5 = ClusterOutput(crv_3)
crv_6 = ClusterOutput(crv_4)

# ==== cluster 狭长判断
crv = ClusterInput()
crv_2 = Curve(graft(crv))
area = Area(Geometry=crv_2)  # -> Area, graft(Centroid)
xy = XYPlane(Origin=area.Centroid)
series = Series(Start=0, Step=5, Count=36)
xz = XZPlane(Origin=area.Centroid)
rotate = Rotate(Geometry=xz, Angle=degrees(series), Plane=xy)  # -> Geometry, Transform
pcx = CurvePlane(Curve=graft(crv_2), Plane=rotate.Geometry)  # -> Points, ParamsC, ParamsP
pline = PolyLine(Vertices=pcx.Points, Closed=False)  # -> simplify(Polyline)
len = Length(Curve=pline)
trim = TrimTree(Tree=len, Depth=1)
bnd = Bounds(Numbers=trim)
dedomain = DeconstructDomain(Domain=bnd)  # -> Start, End
division = Division(A=dedomain.End, B=dedomain.Start)
B = ClusterInput()
larger = LargerThan(FirstNumber=division, SecondNumber=B)  # -> LargerThan, OrEqualTo
dispatch = Dispatch(List=crv_2, DispatchPattern=larger.LargerThan)  # -> simplify(ListA), simplify(ListB)
A = ClusterOutput(dispatch.ListA)
B_2 = ClusterOutput(dispatch.ListB)

# ==== cluster 切分用地
crv = ClusterInput()
crv_2 = Curve(crv)
panel = Panel("平均切割细长用地")
clean = CleanTree(RemoveNulls=True, RemoveInvalid=True, RemoveEmpty=True, Tree=crv_2)
bb2 = BoundBox2(crv=clean, G=0)
explode = Explode(Curve=bb2, Recursive=True)  # -> Segments, Vertices
ll = LongestLine_2(crv=explode.Segments)  # -> crv_5, crv_6
len = Length(Curve=ll.crv_5)
len_2 = Length(Curve=ll.crv_6)
division = Division(A=len, B=len_2)
pframes = PerpFrames(Curve=ll.crv_5, Count=division, Align=True)  # -> simplify(Frames), Parameters
cull_i = CullIndex(List=pframes.Frames, Indices=0, Wrap=True)
cull_i_2 = CullIndex(List=reverse(cull_i), Indices=0, Wrap=True)
sec = BrepPlane(Brep=clean, Plane=cull_i_2)  # -> Curves, Points
trim = TrimTree(Tree=sec.Curves, Depth=1)
ac = AreaCutting(E=simplify(clean), C=trim)
sp = SimplifyPro(data=ac)
D = ClusterOutput(sp)

# ==== cluster Flip2DCurvePro: 统一曲线方向（平面）
crv = ClusterInput()

# ----
# 不适合于单条线段
# 仅限于平面线条
panel = Panel("""统一曲线的方向

成逆时针方向

即参数为正数时向外偏移""")
crv_2 = Curve(crv)
explode = Explode(Curve=crv_2, Recursive=True)  # -> Segments, Vertices
cull_i = CullIndex(List=explode.Vertices, Indices=0, Wrap=True)
avr = Average(Input=cull_i)
# 没有graft多条线会报错
cir = Circle(Plane=avr, Radius=1)
flip = FlipCurve(Curve=graft(crv_2), Guide=cir)  # -> simplify(Curve), Flag

C = ClusterOutput(flip.Curve)

# ==== cluster Cluster_5
crv = ClusterInput()
crv_2 = Curve(crv)
relay = ClusterInput()
fit = FitCurve(Curve=crv_2)
offset = OffsetCurve(Curve=crv_2, Distance=expr("-x", relay), Plane=PlaneXY(0, 0, 0), Corners=1)
offset_2 = OffsetCurve(Curve=fit, Distance=expr("-x", relay), Plane=PlaneXY(0, 0, 0), Corners=1)
area = Area(Geometry=offset_2)  # -> Area, Centroid
area_2 = Area(Geometry=offset)  # -> Area, Centroid
larger = LargerThan(FirstNumber=area_2.Area, SecondNumber=area.Area)  # -> LargerThan, OrEqualTo
cull = CullPattern(List=offset, CullPattern=larger.OrEqualTo)
combine = CombineData(Input0=cull, Input1=offset_2)  # -> Result, Index
explode = Explode(Curve=combine.Result, Recursive=True)  # -> Segments, Vertices
cullpt = CullDuplicates(Points=explode.Vertices, Tolerance="2", CullMode=3)  # -> Points, Indices, Valence
pline = PolyLine(Vertices=cullpt.Points, Closed=True)
crv_3 = Curve(pline)
crv_4 = ClusterOutput(crv_3)

# ==== cluster AreaCutting_2
E = ClusterInput()
boundary = BoundarySurfaces(Edges=E)
C = ClusterInput()
srfsplit = SurfaceSplit(Surface=boundary, Curves=C)
wires = BrepWireframe(Brep=srfsplit, Density=-1)
join = JoinCurves(Curves=wires, Preserve=False)  # -> simplify(Curves)
trim = TrimTree(Tree=join, Depth=1)
crv = Curve(trim)
crv_2 = ClusterOutput(crv)

# ==== cluster 预留最小_2
crv = ClusterInput()
crv_2 = Curve(crv)
area = Area(Geometry=crv_2)  # -> Area, Centroid
lng = ListLength(List=area.Area)
series = Series(Start=0, Step=1, Count=lng)
sort = SortList(Keys=area.Area, ValuesA=series)  # -> Keys, ValuesA
int = ClusterInput()
item = ListItem(List=crv_2, Index=sort.ValuesA, Wrap=True)
int_2 = Integer(int)
cull_i = CullIndex(List=item, Indices=int_2, Wrap=True)  # -> simplify(List)
item_2 = ListItem(List=item, Index=int_2, Wrap=True)  # -> simplify(Item)
L = ClusterOutput(cull_i)
crv_3 = Curve(item_2)
crv_4 = ClusterOutput(crv_3)

# ==== cluster DefaultData: 为Cluster输入端设置默认参数 input: I-输入数据； D-默认数据； V1.0 skywoolf 190620
# 作者：Skywoolf
# NCF参数化建筑联盟：bbs.ncf-china.com
# NCFZ数字设计平台：ncf.cz-studio.com
# 相关书籍：《Grasshopper参数化设计教程》--“数字冥想”
# 共同维护知识产权平台，请勿删除。感谢您对国人设计技术原创的支持！
I = ClusterInput()  # 输入数据
# 开发日志：
# 190620：测试版封装
# //专门为Cluster设置默认数据使用；
# 
# //单个数据成功运算结果：正常
# //Longlist法则测试结果：正常
# //树形数据测试结果：正常
D = ClusterInput()  # 默认数据
data = Data(D)
data_2 = Data(I)
# 祁鹏远 -- NCF站长；C+Z合伙人建筑师
null = NullItem(Item=data_2)  # -> NullFlags, InvalidFlags, Description
item = ListItem(List=null.NullFlags, Index=0, Wrap=True)
filter = StreamFilter(Gate=item, Stream0=data_2, Stream1=data)
O = Data(filter)
O_2 = ClusterOutput(O)  # 输出数据

# ==== cluster TrimTreePlus_2: Trim Tree的升级版，原生电池中的Trim Tree可以说是用来将树形数据降级的最佳选择，通常情况下，它可以保证这条数据流的联动性，当前端数据结构发生变化时，后端不会挂掉。但是，对于只有一级路径名的树形数据，Trim Tree会直接将其砍至没有数据，这种情况会导致我们在打包Cluster的适合，输入端出现无法兼容单个数据和树形数据的bug。所以为了强大Cluster对输入端数据结构的适应能力，我们对Trim Tree的规则做了小小的改进：当T端输入只有一级路径的分组数据时，输出的结果从不输出改为：输出拍平后的数据。这样可以在大多数Cluster能适应对输入不同格式的数据结构； //V1.3 skywoolf 190617 //个别情况下T端要输出的时拍平数据，而不是分组数据，此时该电池并不适用；
# 作者：Skywoolf
# NCF参数化建筑联盟：bbs.ncf-china.com
# NCFZ数字设计平台：ncf.cz-studio.com
# 相关书籍：《Grasshopper参数化设计教程》--“数字冥想”
# 共同维护知识产权平台，请勿删除。感谢您对国人设计技术原创的支持！
T = ClusterInput()  # 待砍级的数据
# 开发日志：
# 190620：测试版封装
# //开发它的原因是因为大部分复杂Cluster的输入端无法做到单个数据和树形数据的兼容，往往树形数据可以运算的适合，连接单个数据就会报bug；
# //有一种特殊情况目前出现的比较少，所以没有考虑：部分运算在Gate1那里不拍平会呈现预想的兼容效果；
# 
# //单个数据成功运算结果：正常
# //Longlist法则测试结果：正常
# //树形数据测试结果：正常
D = ClusterInput()  # 要看去几级路径名
data = Data(T)
int = Integer(D)
trim = TrimTree(Tree=data, Depth=int)
# 祁鹏远 -- NCF站长；C+Z合伙人建筑师
data_2 = Data(flatten(data))
null = NullItem(Item=trim)  # -> NullFlags, InvalidFlags, Description
filter = StreamFilter(Gate=null.NullFlags, Stream0=trim, Stream1=data_2)
data_3 = Data(filter)
T_2 = ClusterOutput(data_3)  # 砍完路径名后的数据

# ==== cluster SimplifyPlus_2: Simplify的升级版，原生电池中Simplify遇到单组数据不会优化数据级，这使得它在于pathmapper搭配的时候经常会出现数据无法联动的困扰。Slimplify Plus在原有基础上增加了新的规则，当多级路径名的单组数据输入给它的时候，它会将数据拍平至最简； //V1.2 skywoolf 190617
# 作者：Skywoolf
# NCF参数化建筑联盟：bbs.ncf-china.com
# NCFZ数字设计平台：ncf.cz-studio.com
# 相关书籍：《Grasshopper参数化设计教程》--“数字冥想”
# 共同维护知识产权平台，请勿删除。感谢您对国人设计技术原创的支持！
# 开发日志：
# 190620：测试版封装
# //为了让Cluster打包后输入端能够兼容单个数据和树形数据，这里对Simplify做的改造，原版Simplify不能自动把单组数据简化；
# //这里增加了对单组数据直接拍平的设置，为了在复杂的运算器过程中，路径名变化能够实现联动控制，不会因为树形转线性后路径名不变而产生bug；
# 
# //单个数据成功运算结果：正常
# //树形数据测试结果：正常
T = ClusterInput()  # 需要简化路径名的数据
data = Data(T)
# 祁鹏远 -- NCF站长；C+Z合伙人建筑师
tstat = TreeStatistics(Tree=data)  # -> Paths, Length, Count
equals = Equality(FirstNumber=tstat.Count, SecondNumber=1)  # -> Equality, Inequality
dispatch = Dispatch(List=data, DispatchPattern=equals.Equality)  # -> ListA, ListB
simplify = SimplifyTree(Tree=dispatch.ListB, Front=True)
flatten = FlattenTree(Tree=dispatch.ListA, Path="{0}")
filter = StreamFilter(Gate=equals.Equality, Stream0=simplify, Stream1=flatten)
data_2 = Data(filter)
T_2 = ClusterOutput(data_2)  # 简化路径名后的数据

# ==== cluster AreaCutting
E = ClusterInput()
boundary = BoundarySurfaces(Edges=graft(E))
C = ClusterInput()
srfsplit = SurfaceSplit(Surface=boundary, Curves=C)
wires = BrepWireframe(Brep=srfsplit, Density=-1)
join = JoinCurves(Curves=wires, Preserve=False)  # -> simplify(Curves)
trim = TrimTree(Tree=join, Depth=1)
crv = Curve(trim)
crv_2 = ClusterOutput(crv)

# ==== cluster SimplifyPro
data = ClusterInput()
data_2 = Data(data)
tstat = TreeStatistics(Tree=data_2)  # -> Paths, Length, Count
equals = Equality(FirstNumber=tstat.Count, SecondNumber="1")  # -> Equality, Inequality
dispatch = Dispatch(List=data_2, DispatchPattern=equals.Equality)  # -> ListA, ListB
simplify = SimplifyTree(Tree=dispatch.ListB, Front=False)
flatten = FlattenTree(Tree=dispatch.ListA, Path="{0}")
filter = StreamFilter(Gate=equals.Equality, Stream0=simplify, Stream1=flatten)
data_3 = Data(filter)
data_4 = ClusterOutput(data_3)

# ==== cluster BoundBox2
crv = ClusterInput()
crv_2 = Curve(crv)
explode = Explode(Curve=crv_2, Recursive=True)  # -> Segments, Vertices
panel = Panel("求包含曲线的最小矩形线框")
hull = ConvexHull(Points=explode.Vertices, Plane=PlaneXY(0, 0, 0))  # -> Hull, HullZ, Indices
area = Area(Geometry=crv_2)  # -> Area, Centroid
crv_cp = CurveClosestPoint(Point=area.Centroid, Curve=hull.Hull)  # -> Point, Parameter, Distance
vec2pt = Vector2Pt(PointA=area.Centroid, PointB=crv_cp.Point, Unitize=False)  # -> Vector, Length
rotate = Rotate(Geometry=vec2pt.Vector, Angle=1.570796327, Plane=PlaneXY(0, 0, 0))  # -> Geometry, Transform

# ---- group: 是否进行长边矫正
explode_2 = Explode(Curve=crv_2, Recursive=True)  # -> Segments, Vertices
ll = LongestLine_2(crv=explode_2.Segments)  # -> crv_5, crv_6
end = EndPoints(Curve=ll.crv_5)  # -> Start, End
xy = XYPlane(Origin=Point(0, 0, 0))
vec2pt_2 = Vector2Pt(PointA=end.Start, PointB=end.End, Unitize=False)  # -> simplify(Vector), Length
align = AlignPlane(Plane=xy, Direction=vec2pt_2.Vector)  # -> Plane, Angle
bbox = BoundingBox(Content=crv_2, Plane=align.Plane)  # -> Box, Box_2
wires = BrepWireframe(Brep=bbox.Box, Density=-1)
join = JoinCurves(Curves=wires, Preserve=False)
uod = UnityOfDirection(crv=join)

# ----
pl = ConstructPlane(Origin=Point(0, 0, 0), XAxis=vec2pt.Vector, YAxis=rotate.Geometry)
bbox_2 = BoundingBox(Content=crv_2, Plane=pl)  # -> Box, Box_2
wires_2 = BrepWireframe(Brep=bbox_2.Box, Density=-1)
join_2 = JoinCurves(Curves=wires_2, Preserve=False)
uod_2 = UnityOfDirection(crv=join_2)
G = ClusterInput()
filter = StreamFilter(Gate=G, Stream0=uod_2, Stream1=uod)
s_0 = ClusterOutput(filter)

# ==== cluster UnityOfDirection
crv = ClusterInput()

panel = Panel("""统一曲线的方向

成逆时针方向

即参数为正数时向外偏移""")
crv_2 = Curve(crv)
explode = Explode(Curve=crv_2, Recursive=True)  # -> Segments, Vertices
cull_i = CullIndex(List=explode.Vertices, Indices=0, Wrap=True)
avr = Average(Input=cull_i)
cir = Circle(Plane=avr, Radius=1)
flip = FlipCurve(Curve=crv_2, Guide=cir)  # -> simplify(Curve), Flag

C = ClusterOutput(flip.Curve)

# ==== cluster LongestLine_2
crv = ClusterInput()
crv_2 = Curve(crv)
len = Length(Curve=crv_2)
bnd = Bounds(Numbers=len)
dedomain = DeconstructDomain(Domain=bnd)  # -> Start, End
equals = Equality(FirstNumber=len, SecondNumber=dedomain.Start)  # -> Equality, Inequality
equals_2 = Equality(FirstNumber=len, SecondNumber=dedomain.End)  # -> Equality, Inequality
cull = CullPattern(List=crv_2, CullPattern=equals_2.Equality)
cull_2 = CullPattern(List=crv_2, CullPattern=equals.Equality)
item = ListItem(List=cull, Index=0, Wrap=True)
item_2 = ListItem(List=cull_2, Index=0, Wrap=True)
crv_3 = Curve(item)
crv_4 = Curve(item_2)
crv_5 = ClusterOutput(crv_3)
crv_6 = ClusterOutput(crv_4)
